# Grasshopper definition Sample.gh (Grasshopper 1.0.7)
# plug-ins: ImageSampler2

number_slider = Slider(50, range=0..100)
number_slider_2 = Slider(3, range=0..10)
planesrf = PlaneSurface(Plane=PlaneXY(0, 0, 0), XSize=Domain(-10, 10), YSize=Domain(-10, 10))
rec = Rectangle(planesrf)
mplane = MeshPlane(Boundary=planesrf, WidthCount=number_slider, HeightCount=number_slider)  # -> Mesh, Area
arrrec = RectangularArray(Geometry=mplane.Mesh, Cell=rec, XCount=number_slider_2, YCount=number_slider_2)  # -> Geometry, Transform
lng = ListLength(List=arrrec.Geometry)
series = Series(Start=0, Step=1, Count=lng)
demesh = DeconstructMesh(Mesh=arrrec.Geometry)  # -> Vertices, Faces, Colours, Normals
nickname = GetExtensions(Path="C:\Users\kazuj\Documents\_IAMAS\認知の境界\2", Extension="jpg")
nickname_2 = ToUV(Pos=demesh.Vertices)
item = ListItem(List=nickname, Index=series, Wrap=True)
vec = Vector(nickname_2)
im2 = ImageSampler2(Path=item, Uv=vec)  # -> simplify(RGB)
rev = ReverseList(List=im2)
ahsl = SplitAHSL(Colour=rev)  # -> Alpha, Hue, Saturation, Luminance
num = Number(expr("1-x", ahsl.Luminance))
multiplication = Multiplication(A=ahsl.Luminance, B=Slider(4, range=0..10))
Z = UnitZ(Factor=multiplication)
move = Move(Geometry=demesh.Vertices, Motion=Z)  # -> Geometry, Transform
conmesh = ConstructMesh(Vertices=move.Geometry, Faces=demesh.Faces, Colours=rev)
